# Dynamo graph ScanXMLtoRevit.dyn (Dynamo 3.2.1.5366)

script_python = Filename(".\RevisaoEnpos24.py")
readText = FileSystem.ReadText()  # unwired: file
xml_do_scan = Filename("C:\Users\PunkRoque\Downloads\panamar_\structure.xml")
levels = Levels("Nível 1")
wall_types = WallTypes("Genérico - 200 mm - Preenchido")
porta_types = FamilyTypes("M_Folha única:0762 x 2032mm")
janela_types = FamilyTypes("M_Fixo:0610 x 1220mm")
python_script_from_string = PythonStringNode(script=readText, IN[0]=xml_do_scan, IN[1]=levels, IN[2]=wall_types, IN[3]=porta_types, IN[4]=janela_types)  # CPython3
